vi "FreqSync.gvi"   [LabVIEW NXG 3.0.0]
inputs:
  "input": c128[]
  "Training codes": c128[]
  "Samples per symbol": f64 = 1
  "error in": error
  "barker code": enum{"5", "7", "11", "random"} = "random"
  "Frame index": i32
outputs:
  "output": c128[]
  "error out": error
  "phase drift": f64
  "intercept": f64
  "phase offset": f64
  "correction angles": f64[]
uses:
  NI::Analysis::Generation::Ramp Pattern by Samples.gvi
  NI::Analysis::Conditioning::Unwrap Phase.gvi
  NI::Analysis::Fitting::Linear Fit.gvi
  NI::Analysis::Geometry::Wrap Angle (Scalar DBL).gvi
diagram:
  call "BarkerCode.gvi"(barker code=$"barker code") -> (subcodes=w1)
  Multiply(w1, $"Samples per symbol") -> w2
  call "Ramp Pattern by Samples.gvi"(samples=w1, end=w2, exclude end=TRUE) -> (ramp pattern=w3)
  # Estimate phase offset between sub codes
  Complex To Polar(r * e^(i*theta)=$"Training codes") -> (theta=w4)
  call "Unwrap Phase.gvi"(input phase=w4, phase unit="radian in, radian out"(0), error in=$"error in") -> (unwrapped phase=w5, error out=w6)
  # Create a linear array for the x axis
  # Compensate for phase offset
  Divide(x=f64 default, y=4) -> w7
  Add(w5, w7) -> w8
  call "Linear Fit.gvi"(method="Bisquare"(2), y=w8, x=w3, error in=w6) -> (slope=w9, intercept=w10, error out=w11)
  call "Wrap Angle (Scalar DBL).gvi"(angle=w10, wrapped angle range="-180 to 180 (-pi to pi)"(1), angle units="radian in, radian out"(0)) -> (wrapped angle=w12)
  Array Size(array=$input) -> (size(s)=w13)
  # n*phase/sub code length
  # from 0 to N
  Add(w13, 0) -> w14
  Multiply(w9, w14) -> w15
  # create phase compensation array
  call "Ramp Pattern by Samples.gvi"(samples=w14, end=w15, error in=w11) -> (ramp pattern=w16, error out=w17)
  Add(w16, w12) -> w18
  Negate(x=w18) -> w19
  Polar To Complex(r=1, theta=w19) -> (r * e^(i*theta)=w20)
  # compensate by multiplying with e^-j(n*phase/sub code length)
  Multiply($input, w20) -> w21
  $output <- w21
  # phase/subcode length
  $"phase drift" <- w9
  # remove sync frame compensation
  $"error out" <- w17
  $intercept <- w10
  Multiply($"Samples per symbol", $"Frame index") -> w22
  Multiply(w9, w22) -> w23
  Subtract(x=w10, y=w23)
  $"phase offset" <- w12
