vi "Receiver.gvi"   [LabVIEW NXG 3.0.0]
inputs:
  "Signal in": c128[]
  "error in": error
  "IQ rate": f64
  "filter parameter": f64 = 0.5
  "filter length": i32 = 8
  "message length (symbols)": i32 = 16
  "sync frame index (symbols)": i32 = 16
  "barker code": enum{"5", "7", "11", "random"} = "random"
  "Symbol rate (sym/s)": i32
  "Min correlation": f64
  "Frame sync": bool
  "Freq sync": bool
  "decoding": bool
outputs:
  "output bit stream": i32[]
  "error out": error
  "Correlation": f64[]
  "IQ diagram": c128[]
  "Symbols downsampled (real)": f64[]
  "Baseband signal (real part)": cluster{"t0": f64, "dt": f64, "Y": f64[]}
  "Eye Diagram (real part)": cluster{"t0": f64, "dt": f64, "Y": f64[]}[]
uses:
  NI::G Core::Error::Filter Error Code.gvi
  NI::Modulation::MT Format Eye Diagram (complex).gvi
diagram:
  Divide(x=$"IQ rate", y=$"Symbol rate (sym/s)") -> w1
  To Long Integer(number=w1) -> w2
  # Frame synch
  # Matched filter
  call "PulseShaping.gvi"(Signal in=$"Signal in", Samples per symbol=w2, filter parameter=$"filter parameter", filter length=$"filter length", error in=$"error in", tx or rx="Rx") -> (signal out=w3, error out=w4)
  call "NormalizeVector.gvi"(Vector=w3) -> (Normalized Vector=w5)
  case ($"Frame sync") {
    frame False, Default {
      w6 = f64[] []
      w7 = w4
      w8 = c128[] []
      w9 = w5
    }
    frame True {
      call "FrameSync.gvi"(input signal=w5, samples per symbol=w2, error in=w4, sync frame index (symbols)=$"sync frame index (symbols)", barker code=$"barker code", Min correlation=$"Min correlation") -> (output signal=w9, Correlation=w6, Training Subcodes=w8, error out=w7)
    }
  }
  Logical And($"Freq sync", $"Frame sync") -> w10
  # Frequency synch
  case (w10) {
    frame False, Default {
      w11 = w7
      w12 = w9
    }
    frame True {
      call "FreqSync.gvi"(input=w9, Training codes=w8, Samples per symbol=w2, Frame index=$"sync frame index (symbols)", error in=w7, barker code=$"barker code") -> (output=w12, error out=w11)
    }
  }
  case ($"Frame sync") {
    frame False, Default {
      w13 = w12
    }
    frame True {
      call "RemoveSyncFrame.gvi"(input=w12, samples per symbol=w2, sync frame index (bits)=$"sync frame index (symbols)", barker code=$"barker code") -> (output=w13)
    }
  }
  call "Downsampler.gvi"(input signal=w13, error in=w11, samples per symbol=w2) -> (output signal=w14, error out=w15)
  # Downsample
  case (w15) {
    frame Error, Default {
      w16 = i8[] []
      w17 = w15
    }
    frame No Error {
      # Symbol mapping
      call "BPSKDemod.gvi"(symbols=w14, error in=w15) -> (output bit stream=w16, error out=w17)
    }
  }
  case ($decoding) {
    frame False, Default {
      Array Subset(array=w16, length0=$"message length (symbols)") -> w18
      w19 = w17
    }
    frame True {
      # Decoding
      call "decode.gvi"(input data=w16, error in=w17) -> (output bit stream=w20, error out=w19)
      # trim remaining section
      Array Subset(array=w20, length0=$"message length (symbols)") -> w18
    }
  }
  $"output bit stream" <- w18
  $Correlation <- w6
  call "Filter Error Code.gvi"(error in=w19, code to clear=1234567) -> (error out=w21)
  # Ignore frame not found error
  $"error out" <- w21
  $"IQ diagram" <- w14
  Complex To Real Imaginary(x + iy=w14) -> (x=w22)
  $"Symbols downsampled (real)" <- w22
  Reciprocal(x=$"IQ rate") -> w23
  Complex To Real Imaginary(x + iy=w13) -> (x=w24)
  To Long Integer(number=w2) -> w25
  Multiply(w25, $"message length (symbols)") -> w26
  Array Subset(array=w24, length0=w26) -> w27
  # Plot signal
  Decimate Array(array=w27) -> (out1=w28)
  w29 = cluster{"t0": f64, "dt": f64, "Y": f64[]} {all zero or empty}
  Property Node(instance in=w29, "Y"=w28, "dt"=w23) -> (instance out=w30)  # Cluster Properties
  $"Baseband signal (real part)" <- w30
  call "MT Format Eye Diagram (complex).gvi"(waveform=w30, symbol rate=$"IQ rate", eye length=2) -> (eye diagram=w31)
  $"Eye Diagram (real part)" <- w31
