vi "ReceiverBlock2.0.gvi"   [LabVIEW NXG 3.0.0]
panel controls:
  "IQ rate": f64 = 160000
  "carrier frequency": f64 = 915000000
  "gain (dB)": f64 = 10
  "active antenna": string = "RX2"
  "Device names": string = "USRP_06"
  "RF Channel": string = "1"
  "Symbol rate (sym/s)": i32 = 10000
  "filter length": i32 = 8
  "message length (symbols)": i32 = 88
  "sync frame index (symbols)": i32 = 44
  "Power Threshold": f64 = 1e-07
  "Frame sync": bool = TRUE
  "Freq sync": bool = TRUE
  "barker code": enum{"5", "7", "11", "random"} = "random"
  "decoding": bool
  "Interleaver": bool
  "filter parameter": f64 = 0.5
  "number of samples per USRP fetch": i64 = 20000
  "Stop_RX_2": bool
  "milliseconds to wait": u32
  "Reset BER": bool
  "Receive sound": bool
panel indicators:
  "actual IQ rate": f64
  "actual carrier frequency": f64
  "actual gain (dB)": f64
  "error out": error
  "dequeueing iteration": i32
  "IQ diagram": c128[]
  "samples/symbol": f64
  "sync frame correlation": f64[]
  "Symbols downsampled": f64[]
  "Baseband signal (real)": cluster{"t0": f64, "dt": f64, "Y": f64[]}
  "enqueueing iteration": i32
  "size(s)": i32
  "power detector": f64[]
  "raw abs signal": f64[]
  "number elements in queue": i32
  "current index": i32
  "one package": f64[]
  "BER graph": f64[]
  "Mean_BER": f64
  "current BER": f64
  "Input array size": i32
  "Output array size": i32
  "Correct Size": bool
  "string": string
  "raw abs signal_2": f64[]
uses:
  NI::USRP::niUSRP Open Rx Session.gvi
  NI::USRP::niUSRP Configure Signal.gvi
  NI::USRP::niUSRP Initiate.gvi
  NI::USRP::niUSRP Fetch Rx Data (CDB).gvi
  NI::Modulation::MT Pack Bits.gvi
  NI::USRP::niUSRP Abort.gvi
  NI::USRP::niUSRP Close Session.gvi
diagram:
  w1 = $"RF Channel"
  call "niUSRP Open Rx Session.gvi"(device names=$"Device names") -> (session handle out=w2, error out=w3)
  Property Node(instance in=w2, "niUSRP"=w1, error in=w3) -> (error out=w4, instance out=w5)
  call "niUSRP Configure Signal.gvi"(active antenna=$"active antenna", session handle=w5, error in=w4, IQ rate=$"IQ rate", carrier frequency=$"carrier frequency", gain=$"gain (dB)", channel list=w1) -> (session handle out=w6, error out=w7, coerced IQ rate=w8, coerced carrier frequency=w9, coerced gain=w10)
  call "niUSRP Initiate.gvi"(session handle=w6, error in=w7) -> (session handle out=w11, error out=w12)
  Obtain Notifier(element data type=bool TRUE, error in=w12, name="error") -> (error out=w13, notifier out=w14)
  Obtain Queue(element data type=c128[] [], error in=w13) -> (error out=w15, queue out=w16)
  w17 = $"number of samples per USRP fetch"
  s1 = w15  # shift register
  s2 = w16  # shift register
  while (iteration -> i1) {
    Get Notifier Status(notifier=w14) -> (latest notification=w18)
    # Producer loop
    case (w18) {
      frame True {
        w19 = w11
        w20 = s2
        w21 = s1
      }
      frame False {
        call "niUSRP Fetch Rx Data (CDB).gvi"(session handle=w11, error in=s1, number of samples=w17, channel list=w1) -> (session handle out=w19, error out=w22, data=w23)
        Enqueue Element(element=w23, error in=w22, queue=s2) -> (error out=w21, queue out=w20)
        call "NotifyError.gvi"(notifier ref=w14, error in=w21)
      }
    }
    $"enqueueing iteration" <- i1
    next s1 = w21
    next s2 = w20
    stop if w18
  }
  Obtain Queue(element data type=u8[] [], error in=w13) -> (error out=w24, queue out=w25)
  s3 = w15  # shift register
  s4 = w16  # shift register
  s5 = uninitialised  # shift register
  s6 = c128[] []  # shift register
  while (iteration -> i2) {
    # Consumer loop
    w26 = $"barker code"
    w27 = $"sync frame index (symbols)"
    w28 = $"message length (symbols)"
    w29 = $"Symbol rate (sym/s)"
    Dequeue Element(error in=s3, queue=s4) -> (element=w30, queue out=w31)
    Insert Into Array(inArray=s6, new=w30) -> w32
    call "BarkerCode.gvi"() -> (length of one subcode=w33, subcodes=w34)
    Multiply(w33, w34) -> w35
    Add(w28, w35) -> w36
    To Double Precision Float(number=w29) -> w37
    Divide(x=w8, y=w37) -> w38
    To Long Integer(number=w38) -> w39
    Multiply(w36, w39) -> w40
    Multiply(w40, 1.25) -> w41
    To Long Integer(number=w41) -> w42
    Initialize Array(element=0+0i) -> w43
    # w44: array to next fetch
    s7 = 0  # shift register
    s8 = uninitialised  # shift register
    s9 = s5  # shift register
    while {
      # s7: current index
      call "PacketDetector.gvi"(input=w32, index=s7, Power Threshold=$"Power Threshold", window length=10) -> (detected?=w45, Calculated power=w46)
      Array Size(array=w32) -> (size(s)=w47)
      # add buffer
      case (w45) {
        frame False, Default {
          # w49: next index
          Add(s7, 10) -> w49
          Subtract(x=w47, y=w49) -> w52
          # check if done
          Is Greater Than 0(x=w52) -> w53
          Not(x=w53) -> w48
          w50 = w15
          w44 = c128[] []
          w51 = s9
        }
        frame True {
          Array Subset(array=w32, index0=s7, length0=w42) -> w54
          Absolute Value(x=w54) -> w55
          $"one package" <- w55
          Add(w42, s7) -> w56
          Subtract(x=w47, y=w56) -> w57
          Is Less Or Equal To 0(x=w57) -> w58
          # check if total frame
          # Stop while loop if checked whole fetch
          # w47: length of fetch
          case (w58) {
            frame False, Default {
              call "Receiver.gvi"(Interleaver=$Interleaver, Signal in=w54, filter length=$"filter length", filter parameter=$"filter parameter", IQ rate=w8, Symbol rate (sym/s)=w29, error in=w15, message length (symbols)=w28, sync frame index (symbols)=w27, barker code=w26, Frame sync=$"Frame sync", Freq sync=$"Freq sync", decoding=$decoding) -> (IQ diagram=w59, Symbols downsampled (real)=w60, output bit stream=w61, Correlation=w62, Baseband signal (real part)=w63, error out=w64)
              # if total frame, run receiver block
              case ($"Receive sound") {
                frame True {
                  Enqueue Element(element=w61, error in=w64, queue=w25) -> (error out=w50)
                  Array Size(array=w61) -> (size(s)=w65)
                  Is Greater Than 0(x=w65) -> w66
                  case (w66) {
                    frame False, Default { }
                    frame True {
                      call "MT Pack Bits.gvi"(input bit stream=w61, bits per integer=8, packed bit order="MSB first", integer format="Unsigned") -> (output integers=w67)
                      Byte Array To String(encoding="Extended ASCII", unsigned byte array=w67) -> (string=w68)
                      $string <- w68
                    }
                  }
                  w51 = f64[] []
                }
                frame False {
                  call "Example signal.gvi"() -> (output bit stream=w69)
                  call "BER.gvi"(Output bit stream=w61, Input bit stream=w69, Array in=s9, error in=w64, Reset BER=$"Reset BER") -> (Correct Size=w70, Output array size=w71, Input array size=w72, current BER=w73, Mean_BER=w74, BER graph=w75, BER array=w51, error out=w50)
                  $"current BER" <- w73
                  $Mean_BER <- w74
                  $"BER graph" <- w75
                  $"Input array size" <- w72
                  $"Output array size" <- w71
                  $"Correct Size" <- w70
                }
              }
              Array Size(array=w54) -> (size(s)=w76)
              $"size(s)" <- w76
              $"sync frame correlation" <- w62
              $"Baseband signal (real)" <- w63
              $"Symbols downsampled" <- w60
              $"IQ diagram" <- w59
              w44 = c128[] []
            }
            frame True {
              # if not total frame, append to next fetch
              Array Subset(array=w54, index0=s7) -> w77
              Insert Into Array(inArray=w43, new=w77) -> w44
              w50 = w15
              w51 = s9
            }
          }
          Subtract(x=w47, y=w56) -> w78
          Is Less Or Equal To 0(x=w78) -> w48
          # w56: index + frame length
          Wait(time to wait=$"milliseconds to wait")
          # next index = current index + frame length +1
          Add(w56, 1) -> w49
        }
      }
      $"current index" <- s7
      # length to check
      Insert Into Array(inArray=s8, new=w46) -> w79
      $"power detector" <- w79
      next s7 = w49
      next s8 = w79
      next s9 = w51
      stop if w48
    }
    Get Queue Status(queue=w31) -> (# elements in queue=w80)
    $"number elements in queue" <- w80
    Absolute Value(x=s6) -> w81
    $"raw abs signal_2" <- w81
    Absolute Value(x=w32) -> w82
    $"raw abs signal" <- w82
    $"samples/symbol" <- w38
    Get Notifier Status(notifier=w14) -> (latest notification=w83, notifier out=w84)
    call "NotifyError.gvi"(notifier ref=w84, Notify anyway=$Stop_RX_2)
    $"dequeueing iteration" <- i2
    next s3 = w50
    next s4 = w31
    next s5 = s9
    next s6 = w44
    stop if w83
  }
  Release Queue(error in=s3, queue=s4) -> (error out=w85)
  call "niUSRP Abort.gvi"(session handle=w19, error in=w85) -> (session handle out=w86, error out=w87)
  call "niUSRP Close Session.gvi"(session handle=w86, error in=w87) -> (error out=w88)
  $"error out" <- w88
  $"actual IQ rate" <- w8
  $"actual carrier frequency" <- w9
  $"actual gain (dB)" <- w10
  call "Sink.gvi"(queue=w25, notifier ref=w14, error in=w24, net address_2="127.0.0.1", sink port=36363)
