vi "Source.gvi"   [LabVIEW NXG 3.0.0]
inputs:
  "error in": error
  "queue in": Queue<u8[]>
  "last message": u8[]
outputs:
  "current messsage": u8[]
  "queue out_2": Queue<u8[]>
  "error out": error
uses:
  source.mli::source matlab
diagram:
  call "source matlab"(error in=$"error in") -> (data=w1, error out=w2)
  $"current messsage" <- w1
  # Call matlab script
  Is Not Equal[ComparisonMode=CompareAggregates](x=$"last message", y=w1) -> w3
  case (w3) {
    frame False, Default {
      w4 = w2
      w5 = $"queue in"
    }
    frame True {
      Enqueue Element(element=w1, error in=w2, queue=$"queue in") -> (error out=w4, queue out=w5)
    }
  }
  $"queue out_2" <- w5
  $"error out" <- w4
