vi "TransmitterBlock.gvi"   [LabVIEW NXG 3.0.0]
panel controls:
  "IQ rate": f64 = 160000
  "carrier frequency": f64 = 915000000
  "Active antenna": string = "TX1"
  "stop": bool
  "Device name": string = "USRP_06"
  "gain": f64
  "RF channel": string = "0"
  "filter parameter": f64 = 0.5
  "filter length": i32 = 8
  "Symbol rate (sym/s)": i32 = 10000
  "Barker insert index": i32 = 44
  "message length (bits)": i32 = 88
  "Barker code": enum{"5", "7", "11", "random"} = "11"
  "Padding length": i32 = 111
  "encode": bool
  "Frame sync": bool = TRUE
  "Send sound": bool
  "Interleaver": bool
panel indicators:
  "actual IQ rate": f64
  "actual carrier frequency": f64
  "actual gain (dB)": f64
  "error out": error
  "Baseband Waveform (absolute value)": waveform<f64>
  "IQ diagram": c128[]
  "actual message length": i32
uses:
  NI::USRP::niUSRP Open Tx Session.gvi
  NI::USRP::niUSRP Configure Signal.gvi
  NI::USRP::niUSRP Write Tx Data (CDB).gvi
  NI::USRP::niUSRP Close Session.gvi
diagram:
  w1 = $"RF channel"
  call "niUSRP Open Tx Session.gvi"(device names=$"Device name") -> (session handle out=w2, error out=w3)
  Property Node(instance in=w2, "niUSRP"=w1, error in=w3) -> (error out=w4, instance out=w5)
  call "niUSRP Configure Signal.gvi"(active antenna=$"Active antenna", session handle=w5, error in=w4, IQ rate=$"IQ rate", carrier frequency=$"carrier frequency", gain=$gain, channel list=w1) -> (session handle out=w6, error out=w7, coerced IQ rate=w8, coerced carrier frequency=w9, coerced gain=w10)
  while {
    case ($"Send sound") {
      frame False, Default {
        call "Example signal.gvi"(message length (bits)=$"message length (bits)") -> (output bit stream=w11)
        w12 = w7
      }
      frame True {
        w11 = i8[] []
        w12 = w7
      }
    }
    call "Transmitter.gvi"(filter parameter=$"filter parameter", filter length=$"filter length", Interleaver=$Interleaver, input bit stream=w11, IQ rate=w8, Symbol rate (sym/s)=$"Symbol rate (sym/s)", Frame sync=$"Frame sync", error in=w12, Barker code=$"Barker code", Barker insert index=$"Barker insert index", encode=$encode) -> (signal out=w13, IQ diagram=w14, error out=w15)
    Divide(x=w8, y=$"Symbol rate (sym/s)") -> w16
    call "ZeroPadding.gvi"(Input=w13, Padding length=$"Padding length", samples per symbol=w16) -> (output array=w17)
    call "niUSRP Write Tx Data (CDB).gvi"(session handle=w6, error in=w15, data=w17, end of data?=$stop, channel list=w1) -> (session handle out=w18, error out=w19)
    Logical Or(w19, $stop) -> w20
    Absolute Value(x=w17) -> w21
    Reciprocal(x=$"Symbol rate (sym/s)") -> w22
    Build Waveform Node(Y=w21, dt=w22) -> (output waveform=w23)
    $"Baseband Waveform (absolute value)" <- w23
    $"IQ diagram" <- w14
    Array Size(array=w11) -> (size(s)=w24)
    $"actual message length" <- w24
    stop if w20
  }
  call "niUSRP Close Session.gvi"(session handle=w18, error in=w19) -> (error out=w25)
  $"error out" <- w25
  $"actual IQ rate" <- w8
  $"actual carrier frequency" <- w9
  $"actual gain (dB)" <- w10
